# Grasshopper definition FinStoryPoleCopyandRenametoTickets_v4.0.gh (Grasshopper 1.0.7)
# plug-ins: Wombat, TT Toolbox, treesloth01, Moonlight, HFTidyCanvas

panel = Panel("""PID-NEU-SW-3L-035+PNL-NEU-A502-001
PID-NEU-SW-3L-037+PNL-NEU-A309-001
PID-NEU-SE-3L-001+PNL-NEU-A308-A01
PID-NEU-SE-3L-002+PNL-NEU-A109-A01
PID-NEU-SE-3L-003+PNL-NEU-A109-A01
PID-NEU-SE-3L-004+PNL-NEU-A109-A01
PID-NEU-SE-3L-005+PNL-NEU-A109-A01
PID-NEU-SE-3L-006+PNL-NEU-A109-A01
PID-NEU-SE-3L-007+PNL-NEU-A109-A01
PID-NEU-SE-3L-008+PNL-NEU-A109-A01
PID-NEU-SE-3L-009+PNL-NEU-A109-A01
PID-NEU-SE-3L-010+PNL-NEU-A109-A01
PID-NEU-SE-3L-011+PNL-NEU-A109-A01
PID-NEU-SE-3L-012+PNL-NEU-A109-A01
PID-NEU-SE-3L-013+PNL-NEU-A109-A01
PID-NEU-SE-3L-014+PNL-NEU-A109-A01
PID-NEU-SE-3L-015+PNL-NEU-A109-A01
PID-NEU-SE-3L-016+PNL-NEU-A109-A01
PID-NEU-SE-3L-017+PNL-NEU-A109-A01
PID-NEU-SE-3L-018+PNL-NEU-A109-A01
PID-NEU-SE-3L-019+PNL-NEU-A109-A01
PID-NEU-SE-3L-020+PNL-NEU-A109-A01
PID-NEU-SE-3L-021+PNL-NEU-A109-A01
PID-NEU-SE-3L-022+PNL-NEU-A109-A01
PID-NEU-SE-3L-023+PNL-NEU-A109-A01
PID-NEU-SE-3L-024+PNL-NEU-A109-A01
PID-NEU-SE-3L-025+PNL-NEU-A109-A01
PID-NEU-SE-3L-026+PNL-NEU-A405-A01
PID-NEU-SE-3L-027+PNL-NEU-A405-A01
PID-NEU-SE-3L-028+PNL-NEU-A405-A01
PID-NEU-SE-3L-029+PNL-NEU-A109-A01
PID-NEU-SE-3L-030+PNL-NEU-A109-A01
PID-NEU-SE-3L-031+PNL-NEU-A109-A01
PID-NEU-SE-3L-032+PNL-NEU-A109-A01
PID-NEU-SE-3L-033+PNL-NEU-A109-A01
PID-NEU-SE-3L-034+PNL-NEU-A109-A01
PID-NEU-SE-3L-035+PNL-NEU-A109-A01
PID-NEU-SE-3L-036+PNL-NEU-A109-A01
PID-NEU-SE-3L-037+PNL-NEU-A109-A01
PID-NEU-SE-3L-038+PNL-NEU-A109-A01
PID-NEU-SE-3L-039+PNL-NEU-A109-A01
PID-NEU-SE-3L-040+PNL-NEU-A317-A01
PID-NEU-SE-3L-041+PNL-NEU-A316-001
PID-NEU-SE-3L-042+PNL-NEU-A116-001
PID-NEU-SW-03-035+PNL-NEU-A500-006
PID-NEU-SW-03-037+PNL-NEU-A304-002
PID-NEU-SE-03-001+PNL-NEU-A303-A03
PID-NEU-SE-03-002+PNL-NEU-A100-A72
PID-NEU-SE-03-003+PNL-NEU-A100-A72
PID-NEU-SE-03-004+PNL-NEU-A100-A72
PID-NEU-SE-03-005+PNL-NEU-A100-A72
PID-NEU-SE-03-006+PNL-NEU-A100-A72
PID-NEU-SE-03-007+PNL-NEU-A100-A72
PID-NEU-SE-03-008+PNL-NEU-A100-A72
PID-NEU-SE-03-009+PNL-NEU-A100-A72
PID-NEU-SE-03-010+PNL-NEU-A100-A72
PID-NEU-SE-03-011+PNL-NEU-A100-A72
PID-NEU-SE-03-012+PNL-NEU-A100-A72
PID-NEU-SE-03-013+PNL-NEU-A100-A72
PID-NEU-SE-03-014+PNL-NEU-A100-A72
PID-NEU-SE-03-015+PNL-NEU-A100-A72
PID-NEU-SE-03-016+PNL-NEU-A100-A72
PID-NEU-SE-03-017+PNL-NEU-A100-A72
PID-NEU-SE-03-018+PNL-NEU-A100-A72
PID-NEU-SE-03-019+PNL-NEU-A100-A72
PID-NEU-SE-03-020+PNL-NEU-A100-A72
PID-NEU-SE-03-021+PNL-NEU-A100-A72
PID-NEU-SE-03-022+PNL-NEU-A100-A72
PID-NEU-SE-03-023+PNL-NEU-A100-A72
PID-NEU-SE-03-024+PNL-NEU-A100-A72
PID-NEU-SE-03-025+PNL-NEU-A100-A72
PID-NEU-SE-03-026+PNL-NEU-A401-A06
PID-NEU-SE-03-027+PNL-NEU-A401-A06
PID-NEU-SE-03-028+PNL-NEU-A401-A06
PID-NEU-SE-03-029+PNL-NEU-A100-A72
PID-NEU-SE-03-030+PNL-NEU-A100-A72
PID-NEU-SE-03-031+PNL-NEU-A100-A72
PID-NEU-SE-03-032+PNL-NEU-A100-A72
PID-NEU-SE-03-033+PNL-NEU-A100-A72
PID-NEU-SE-03-034+PNL-NEU-A100-A72
PID-NEU-SE-03-035+PNL-NEU-A100-A72
PID-NEU-SE-03-036+PNL-NEU-A100-A72
PID-NEU-SE-03-037+PNL-NEU-A100-A72
PID-NEU-SE-03-038+PNL-NEU-A100-A72
PID-NEU-SE-03-039+PNL-NEU-A100-A72
PID-NEU-SE-03-040+PNL-NEU-A312-A01
PID-NEU-SE-03-041+PNL-NEU-A310-001
PID-NEU-SE-03-042+PNL-NEU-A100-002
PID-NEU-SE-03-043+PNL-NEU-A500-015
PID-NEU-NE-03-001+PNL-NEU-B103-A01
PID-NEU-NE-03-002+PNL-NEU-B103-A02
PID-NEU-NE-03-003+PNL-NEU-B103-A02
PID-NEU-NE-03-004+PNL-NEU-B303-A03
PID-NEU-NE-03-004.1+PNL-NEU-A318-001
PID-NEU-NE-03-004.2+PNL-NEU-A500-008
PID-NEU-NE-03-005+PNL-NEU-A113-A01
PID-NEU-NE-03-006+PNL-NEU-A113-A02
PID-NEU-NE-03-007+PNL-NEU-A113-A02
PID-NEU-NE-03-008+PNL-NEU-A113-A02
PID-NEU-NE-03-009+PNL-NEU-A113-A02
PID-NEU-NE-03-010+PNL-NEU-A113-A02
PID-NEU-NE-03-011+PNL-NEU-A113-A02
PID-NEU-NE-03-012+PNL-NEU-A113-A02
PID-NEU-NE-03-013+PNL-NEU-A113-A03
PID-NEU-NE-03-014+PNL-NEU-A113-002
PID-NEU-NE-03-015+PNL-NEU-A113-002
PID-NEU-NE-03-016+PNL-NEU-A113-002
PID-NEU-NE-03-017+PNL-NEU-A113-002
PID-NEU-NE-03-018+PNL-NEU-A113-002
PID-NEU-NE-03-019+PNL-NEU-A113-002
PID-NEU-NE-03-020+PNL-NEU-A113-002
PID-NEU-NE-03-021+PNL-NEU-A113-002
PID-NEU-NE-03-022+PNL-NEU-A115-001
PID-NEU-NE-03-023+PNL-NEU-A115-001
PID-NEU-NE-03-024+PNL-NEU-A115-001
PID-NEU-NE-03-025+PNL-NEU-A115-001
PID-NEU-NE-03-026+PNL-NEU-A115-001
PID-NEU-NE-03-027.1+PNL-NEU-A406-001
PID-NEU-NE-03-027.2+PNL-NEU-A408-001
PID-NEU-NE-03-028+PNL-NEU-A407-001
PID-NEU-NE-03-029+PNL-NEU-A100-A43
PID-NEU-NE-03-030+PNL-NEU-A100-A42
PID-NEU-NE-03-031+PNL-NEU-A100-A41
PID-NEU-NE-03-032+PNL-NEU-A100-A40
PID-NEU-NE-03-033+PNL-NEU-A100-A39
PID-NEU-NE-03-034+PNL-NEU-A100-A37
PID-NEU-NE-03-035+PNL-NEU-A100-A37
PID-NEU-NE-03-036+PNL-NEU-A100-A37
PID-NEU-NE-03-037+PNL-NEU-A100-A37
PID-NEU-NE-03-038+PNL-NEU-A100-A37
PID-NEU-NE-03-039+PNL-NEU-A304-A03
PID-NEU-NE-03-040+PNL-NEU-A303-002
PID-NEU-NE-03-041+PNL-NEU-A100-006
PID-NEU-NE-03-042+PNL-NEU-A500-009
PID-NEU-NW-03-001+PNL-NEU-A102-A01
PID-NEU-NW-03-002+PNL-NEU-A102-A02
PID-NEU-NW-03-003+PNL-NEU-A102-A02
PID-NEU-NW-03-004+PNL-NEU-A102-A02
PID-NEU-NW-03-005+PNL-NEU-A102-A02
PID-NEU-NW-03-006+PNL-NEU-A102-A02
PID-NEU-NW-03-007+PNL-NEU-A102-A02
PID-NEU-NW-03-008+PNL-NEU-A101-A07
PID-NEU-NW-03-009+PNL-NEU-A101-A08
PID-NEU-NW-03-010+PNL-NEU-A101-A09
PID-NEU-NW-03-011+PNL-NEU-A100-A72
PID-NEU-NW-03-012+PNL-NEU-A100-A72
PID-NEU-NW-03-013+PNL-NEU-A100-A72
PID-NEU-NW-03-014+PNL-NEU-A100-A72
PID-NEU-NW-03-015+PNL-NEU-A100-A72
PID-NEU-NW-03-016+PNL-NEU-A100-A72
PID-NEU-NW-03-017+PNL-NEU-A100-A72
PID-NEU-NW-03-018+PNL-NEU-A100-A72
PID-NEU-NW-03-019+PNL-NEU-A100-A72
PID-NEU-NW-03-020+PNL-NEU-A100-A52
PID-NEU-NW-03-021+PNL-NEU-A100-A53
PID-NEU-NW-03-022+PNL-NEU-A100-A54
PID-NEU-NW-03-023+PNL-NEU-A100-A55
PID-NEU-NW-03-024+PNL-NEU-A100-A56
PID-NEU-NW-03-025+PNL-NEU-A100-A57
PID-NEU-NW-03-026+PNL-NEU-A401-A02
PID-NEU-NW-03-027+PNL-NEU-A401-A02
PID-NEU-NW-03-028+PNL-NEU-A401-A02
PID-NEU-NW-03-029+PNL-NEU-A401-A02
PID-NEU-NW-03-030+PNL-NEU-A100-A58
PID-NEU-NW-03-031+PNL-NEU-A100-A59
PID-NEU-NW-03-032+PNL-NEU-A100-A60
PID-NEU-NW-03-033+PNL-NEU-A100-A61
PID-NEU-NW-03-034+PNL-NEU-A100-A62
PID-NEU-NW-03-035+PNL-NEU-A100-A63
PID-NEU-NW-03-036+PNL-NEU-A100-A72
PID-NEU-NW-03-037+PNL-NEU-A100-A72
PID-NEU-NW-03-038+PNL-NEU-A100-A72
PID-NEU-NW-03-039+PNL-NEU-A120-A02
PID-NEU-NW-03-040+PNL-NEU-A120-A02
PID-NEU-NW-03-041+PNL-NEU-A120-A01
PID-NEU-NW-03-042+PNL-NEU-A500-009
PID-NEU-SW-03-008+PNL-NEU-A102-B01
PID-NEU-SW-03-009+PNL-NEU-A100-B03
PID-NEU-SW-03-010+PNL-NEU-A100-B04
PID-NEU-SW-03-011+PNL-NEU-A100-C02
PID-NEU-SW-03-012+PNL-NEU-A100-A72
PID-NEU-SW-03-013+PNL-NEU-A100-A72
PID-NEU-SW-03-014+PNL-NEU-A401-A08
PID-NEU-SW-03-015+PNL-NEU-A401-A08
PID-NEU-SW-03-016+PNL-NEU-A401-A08
PID-NEU-SW-03-016.1+PNL-NEU-A100-A72
PID-NEU-SW-03-017+PNL-NEU-A100-A72
PID-NEU-SW-03-018+PNL-NEU-A100-A72
PID-NEU-SW-03-019+PNL-NEU-A100-A72
PID-NEU-SW-03-020+PNL-NEU-A100-A72
PID-NEU-SW-03-025+PNL-NEU-A100-A72
PID-NEU-SW-03-026+PNL-NEU-A401-A08
PID-NEU-SW-03-027+PNL-NEU-A401-A08
PID-NEU-SW-03-028+PNL-NEU-A401-A08
PID-NEU-SW-03-029+PNL-NEU-A100-A33
PID-NEU-SW-03-030+PNL-NEU-A500-005
PID-NEU-SW-03-031+PNL-NEU-B101-002
PID-NEU-SW-03-032+PNL-NEU-B101-001
PID-NEU-SW-03-033+PNL-NEU-B101-001
PID-NEU-SW-03-034+PNL-NEU-B101-002
PID-NEU-SW-03-021+PNL-NEU-A100-A72
PID-NEU-SW-03-022+PNL-NEU-A100-A72
PID-NEU-SW-03-023+PNL-NEU-A100-A72
PID-NEU-SW-03-024+PNL-NEU-A100-A72
PID-NEU-NW-03-043+PNL-NEU-A305-002
PID-NEU-SW-03-001+PNL-NEU-C300-B02
PID-NEU-SW-03-002+PNL-NEU-C101-B05
PID-NEU-SW-03-003+PNL-NEU-C101-B04
PID-NEU-SW-03-004+PNL-NEU-C101-B04
PID-NEU-SW-03-005+PNL-NEU-C101-B04
PID-NEU-SW-03-006+PNL-NEU-C101-B04
PID-NEU-SW-03-007+PNL-NEU-C101-B06""")

# ----
# Step2: - Parse Panel Fin Production Tracker( NEU_IEF_Panel Tarcker from fab team)
boolean_toggle = BooleanToggle(True)
file_path = FilePath("C:\Users\ashinde\Island International Industries\NEU - FAB TEAM - General\NEU_IEF_Panel Tracker.xlsx")
worksheet_title = Panel("Panel Tracker")
panel_2 = Panel(file_path)
read_excel_sheet = ReadExcelSheet(Run=boolean_toggle, FilePath=file_path, Worksheet=worksheet_title, Listen=False)  # -> UserMessages, Columns, Rows
param_viewer = ParamViewer(read_excel_sheet.Columns)
tree_branch = TreeBranch(Tree=read_excel_sheet.Rows, Path="{1}", MaintainPaths=True)
panel_3 = Panel(tree_branch)

# ----
# Step1b: - Choose the Lot specific to Step1
floor_release = Slider(1, range=1..9)
subrelease = Slider(7, range=1..9)
concatenate = Concatenate(A="L", B="0", C=floor_release)
concatenate_2 = Concatenate(FragmentA="0", FragmentB=subrelease)
concatenate_3 = Concatenate(FragmentA=concatenate, FragmentB=concatenate_2, JoinSeparator="-")  # -> flatten(Result)
lot_number = Panel(concatenate_3)

# ----
# Step1 a:-Select Lot to process & path to copy files to
file_path_2 = FilePath("C:\Users\ashinde\OneDrive - Island International Industries\Desktop\Abhishek Sept-Oct2021\NEU Project Panel Tickets\")
dir_path_to_copy_files_to = Panel(file_path_2)
selected_by_user_lot_number = Panel(concatenate_3)
concatenate_4 = Concatenate(
    Fragment_A=dir_path_to_copy_files_to,
    Fragment_C=selected_by_user_lot_number,
    Fragment_D="\",
    Fragment_E="Fabrication Tickets")

# ----
# Step0 :-Select PNL PDF Repository directory to copy files from
file_path_3 = FilePath("V:\01 PROJECT FOLDERS\20-801-045 NEU\03 Design & Engineering\05 Fabrication Model\03_Panel Production\03_1_Panel Production Files\REPOSITORY\PNL\PDF\")
pnl_s_pdf_folder_from_repository = Panel(file_path_3)
fnmatch_filter = Panel("*.pdf")
ghpython_script = GhPythonScript(directory_path=pnl_s_pdf_folder_from_repository, filter=fnmatch_filter)  # -> out, filtered_file_names, filtered_file_paths, extension_stripped_filtered_file_names
# ---------- ghpython_script: Python ----------
"""
Extract File paths & File Names from a specified directory with a extension filter

__author__= "Abhishek S Shinde"
__datecreated__ = "11.01.2021"
__copyright__ = "ashinde@islandcompanies.com"

"""

__author__ = "ashinde"
__version__ = "2021.08.04"

import rhinoscriptsyntax as rs
import os
import fnmatch
import glob


file_paths = []
filtered_file_paths =[]
extension_stripped_filtered_file_names = []

converted_dir_path = directory_path.replace('\\','\\\\')
print(converted_dir_path)

file_names = os.listdir(directory_path)
filtered_file_names = fnmatch.filter(file_names, filter)

for filename in filtered_file_names:
    extstripped_file_name = filename.strip(".pdf")
    file_path = r'{}{}'.format(converted_dir_path,filename)
    filtered_file_paths.append(file_path)
    extension_stripped_filtered_file_names.append(extstripped_file_name)

#print(filtered_file_names)
# ---------- end ghpython_script ----------

# ----
# Island Exterior Fabricators LLC
# Project Name- NorthEastern University
# Author - Abhishek S Shinde
# Checked By - Aaron DeHaan
# Project Manager - Tyler Rachel,Jose Machado
# Description-
# This Script makes copy of PDF's from BFS based on corresponding PID's
# to be later merged with Story Pole Drawings from IEF
moonlight = Moonlight(Mode=True)  # disabled

panel_4 = Panel(concatenate_4)

relay = DataDescription(read_excel_sheet.Columns)
relay_2 = DataDescription(read_excel_sheet.Columns)
relay_3 = DataDescription(read_excel_sheet.Columns)
relay_4 = DataDescription(read_excel_sheet.Columns)

# ----
# StepXX :- Comparing two list ( excel and PNL pdf names to see if any PDF is missing
pnl_pdf_from_bfs_names_without_extension = Panel(ghpython_script.filtered_file_paths)

index_for_pid_column = Panel("1")
index_for_pnl_pid_column = Panel("21")
index_for_lot_number_released_by_bfs = Panel("20")
index_for_pnl_column = Panel("2")
tree_branch_index = TreeBranchIndex(DataTree=relay, BranchIndex=index_for_pnl_pid_column)
tree_branch_index_2 = TreeBranchIndex(DataTree=relay_3, BranchIndex=index_for_pnl_column)
tree_branch_index_3 = TreeBranchIndex(DataTree=relay_4, BranchIndex=index_for_pid_column)
tree_branch_index_4 = TreeBranchIndex(DataTree=relay_2, BranchIndex=index_for_lot_number_released_by_bfs)
trim_data_ends = TrimDataEnds(Data=tree_branch_index_2, ListStart=1, ListEnd=0, PathStart=0, PathEnd=0, RenumberPaths=True)
trim_data_ends_2 = TrimDataEnds(Data=tree_branch_index_3, ListStart=1, ListEnd=0, PathStart=0, PathEnd=0, RenumberPaths=True)
trim_data_ends_3 = TrimDataEnds(Data=tree_branch_index, ListStart=1, ListEnd=0, PathStart=0, PathEnd=0, RenumberPaths=True)
trim_data_ends_4 = TrimDataEnds(Data=tree_branch_index_4, ListStart=1, ListEnd=0, PathStart=0, PathEnd=0, RenumberPaths=True)
panel_5 = Panel(tree_branch_index_3)
panel_6 = Panel(tree_branch_index)
panel_7 = Panel(tree_branch_index_4)
panel_8 = Panel(tree_branch_index_2)

# ----
# PNL Pdf names without extension
# from Repository
# PNL names specific to selected LOT
# from Panel Tracker
set = PNLPdfNamesWithoutExtension(pnl_pdf_from_bfs_names_without_extension)

unsorted_lot_pid_values = Panel(trim_data_ends_2)
unsorted_lot_pnl_values = Panel(trim_data_ends)
unsorted_lot_s_pnl_pid_names = Panel(trim_data_ends_3)
lot_number_2 = Panel(trim_data_ends_4)

# ----
# Step4: - Filtering based on selected LOT
# from Step 3
ghpython_script_2 = GhPythonScript(lotfromtracker=lot_number_2, lotforproduction=lot_number)  # -> out, lotexcludepattern; inputs lotfromtracker: list
# ---------- ghpython_script_2: Python ----------
__author__ = "ashinde"
__version__ = "2021.08.09"

lotexcludepattern = []
for lotvalues in lotfromtracker:
    if lotvalues != lotforproduction:
        lotexcludepattern.append("False")
    elif lotvalues == lotforproduction:
        lotexcludepattern.append("True")
# ---------- end ghpython_script_2 ----------
text = Text(ghpython_script_2.lotexcludepattern)
text_2 = Text(ghpython_script_2.lotexcludepattern)
text_3 = Text(ghpython_script_2.lotexcludepattern)
cull_pattern = CullPattern(List=unsorted_lot_pid_values, CullPattern=text)
cull_pattern_2 = CullPattern(List=unsorted_lot_s_pnl_pid_names, CullPattern=text_2)
cull_pattern_3 = CullPattern(List=lot_number_2, CullPattern=text_3)

text_4 = Text(ghpython_script_2.lotexcludepattern)
cull_pattern_4 = CullPattern(List=unsorted_lot_pnl_values, CullPattern=text_4)

sorted_lot_number = Panel(cull_pattern_3)
sorted_lot_s_pid_values = Panel(cull_pattern)
sorted_lot_s_pnl_pdf_names = Panel(cull_pattern_2)

sorted_lot_s_pnl_values = Panel(cull_pattern_4)
create_set = CreateSet(List=sorted_lot_s_pnl_values)  # -> Set, Map
pnl_file_names_from_excel_tracker = Panel(create_set.Set)
concatenate_5 = Concatenate(FragmentA=pnl_file_names_from_excel_tracker, FragmentB=".pdf")

pnl_file_names_from_excel_tracker_2 = PNLFileNamesFromExcelTracker(concatenate_5)

ghpython_script_3 = GhPythonScript(filepaths_to_copy_from=set, file_names_from_tracker=pnl_file_names_from_excel_tracker_2)  # -> out, present, notpresent; inputs filepaths_to_copy_from: list, file_names_from_tracker: list
# ---------- ghpython_script_3: Python ----------
"""
Compare a file is in another file
"""

__author__ = "ashinde"
__version__ = "2021.11.02"

from re import search
#search(filename,filepath)
present = set()
notpresent = set()

for filepath in filepaths_to_copy_from:
    for filename in file_names_from_tracker:
        if filename in filepath:
            #print("True")
            present.add(filepath)
        else:
            #print("False")
            notpresent.add(filepath)
# ---------- end ghpython_script_3 ----------
present = DataDescription(graft(ghpython_script_3.present))
file_name_from_file_path = FileNameFromFilePath(FilePath=present)  # -> Name, NameWithExtension
pnl_file_names_to_be_copied_from = Panel(file_name_from_file_path.Name)

# ----
# Report if any missing PNL PDF's as a report
set_difference = SetDifference(SetA=present, SetB=pnl_pdf_from_bfs_names_without_extension)
missing_pnl_pdf_s_inside_repository = Panel(set_difference)

# ----
# PNL "PDF" names
# from  BFS
text_5 = Text(pnl_file_names_to_be_copied_from)

panel_9 = DataDescription(simplify(text_5))
present_2 = Present(simplify(present))
pnl_pdf_s_from_bfs = Panel(text_5)
member_index = MemberIndex(Set=sorted_lot_s_pnl_values, Member=pnl_pdf_s_from_bfs)  # -> Index, Count
list_item = ListItem(List=sorted_lot_s_pnl_pdf_names, Index=member_index.Index, Wrap=True)  # -> simplify(Item)

original_file_names_of_pnl = Panel(panel_9)
files_to_copy_from = Panel(present_2)
concatenate_6 = Concatenate(A=concatenate_4, B="\", Fragment_A=original_file_names_of_pnl, Fragment_B=".pdf")
files_to_copy_to = Panel(concatenate_6)

result = DataDescription(concatenate_6)

# ----
# Step6 : FINAL Step:
# Copy original PNL PDF from Reposiotry to
# local folder
toggle = BooleanToggle(False)
copyfile = CopyMoveRenameFiles(Run=toggle, FromPath=files_to_copy_from, ToPath=files_to_copy_to, Move=Toggle(False))

from_path = FilesToCopyFrom(files_to_copy_from)

# ----
# Step5: - Visual Check for comparing values from script vs the tracker values
# before making copies of pdf
pnl_names_from_bfs = Panel(text_5)

member_index_2 = MemberIndex(Set=sorted_lot_s_pnl_values, Member=pnl_pdf_s_from_bfs)  # -> Index, Count
list_item_2 = ListItem(List=sorted_lot_s_pid_values, Index=member_index_2.Index, Wrap=True)  # -> simplify(Item)
panel_10 = Panel(list_item_2)
create_set_2 = CreateSet(List=panel_10)  # -> Set, Map
sorted_lot_pid_values_corresponding_to_b = Panel(create_set_2.Set)  # "SORTED LOT PID VALUES corresponding to BFS"

data = Data(sorted_lot_pid_values_corresponding_to_b)
list_length = ListLength(List=data)
null_object = NullObject()
dispatch = Dispatch(List=null_object, DispatchPattern=list_length)  # -> ListA, ListB
data_2 = Data([data, dispatch.ListB])

replace_empty_to_null = Panel(data_2)

replace_nulls = ReplaceNulls(Items=replace_empty_to_null, Replacements="Missing")  # -> Items, Count

replace_null_with_text_string = Panel(replace_nulls.Items)

# ----
# Corresponding "PID" VALUES
# includes "MISSING" VALUES
# from LOT's  folder
text_6 = Text(replace_null_with_text_string)

corresponding_pid_names_from_the_member = Panel(text_6)  # "Corresponding PID names from the Member Index"

concatenate_7 = Concatenate(FragmentA=pnl_names_from_bfs, FragmentB=corresponding_pid_names_from_the_member, JoinSeparator="+")
concatenate_8 = Concatenate(A=concatenate_4, B="\", Fragment_A=concatenate_7, Fragment_B=".pdf")
panel_11 = DataDescription(simplify(concatenate_8))

files_to_rename_into = Panel(panel_11)

tree = FilesToRenameInto(flatten(files_to_rename_into))
tree_statistics = TreeStatistics(Tree=tree)  # -> Paths, Length, Count
panel_12 = Panel(tree_statistics.Length)
to_path = FilesToRenameInto(files_to_rename_into)

# ----
# Step7 : FINAL Step:
# Copy original PNL PDF and rename them as per PID and copy to local folder
toggle_2 = BooleanToggle(False)
copyfile_2 = CopyMoveRenameFiles(Run=toggle_2, FromPath=from_path, ToPath=to_path, Move=Toggle(False))
