# Grasshopper definition DrillHoleTest.gh (Grasshopper 1.0.7)

new_screwcircle_height = Slider(70, range=20..70)
circle_radius = Number(4.5)
cylinder_height_factor = Number(150)
input_brep = Brep(<brep referenced from the Rhino model>)

new_screwcircle_height_2 = Number(4.5)
xy = XYPlane(Origin=Point(0, 0, 0))
X = UnitX(Factor=100)
bbox = BoundingBox(Content=input_brep, Plane=xy)  # -> Box, Box_2
move = Move(Geometry=xy, Motion=X)  # -> Geometry, Transform
volume = Volume(Geometry=bbox.Box_2)  # -> Volume, Centroid
num = Number(circle_radius)
num_2 = Number(cylinder_height_factor)
cir = Circle(Plane=volume.Centroid, Radius=num)
Z = UnitZ(Factor=num_2)
cir_2 = Circle(Plane=move.Geometry, Radius=num)
Z_2 = UnitZ(Factor=new_screwcircle_height)
extr = Extrude(Base=cir_2, Direction=Z_2)
extr_2 = Extrude(Base=cir, Direction=Z)
cap = CapHoles(Brep=extr)
cap_2 = CapHoles(Brep=extr_2)
sdiff = SolidDifference(BrepsA=input_brep, BrepsB=cap_2)
output_brep = Brep(flatten([sdiff, cap]))
