# Grasshopper definition IEF_RunExternalPython_v1.0.gh (Grasshopper 1.0.7)

# ---- group: Run_External_Python_Scripts_V_1.0
# Run External Python Script & Process a Text file from inside GHPython
# Code inside GH Component: import sys
# sys.path.append('C:\\Users\\XXX\\Desktop')
# import test
# 
# if active:
#     filePath = test.test()
#     print filePath
# Code inside external Python file(testPy.py): import os
# 
# def test():
#     path = 'C:\\test.txt'
#     with open (path, 'w') as file:
#         file.write ("Write your message!")
#     if os.path.isfile(path):
#         return path
#     else:
#     	return None
# Note:(To run this component make sure the GH file which has this component
# is located in the same folder as the external python file and external text file to process).
# 
# KEY:- This component calls function inside External Python file. We can use this technique for external Python files.
# Even  if GH file path is not same as the python and text file it is okay. But this needs to be tested.
toggle = BooleanToggle(False)
python = PythonScript(runExtPy=toggle)  # -> out, printStatus
# ---------- python: Python ----------
__author__ = "EXD-AS| ashinde |Abhishek Shinde"
__contact__ = "arabhishek1091@gmail.com | ashinde@umich.edu "
__datecreated__ = "05.20.2022"

"""
GOAL: Run External Python Scripts & Process a Text file from inside GHPython
      We are running an external Python file inside GH using Boolean Toggle 
      
      NOTE: This GH file must be located in same folder as to where the Python file is located
      
"""

#STEP1 - Importing the sys module 
import sys

#STEP2 - Importing the Python file as a module
import testPy

#STEP3 - Append the Root Directory where both the Python file and Text file to work on is located
sys.path.append("C:\Users\ashinde\OneDrive - Island International Industries\Desktop\CD_AS_IEF\PythonDevelopment_AS_IEF\externalPy")

if runExtPy:
    #the variable filePath will take the return value from function test() inside testPy file
    filePath = testPy.test()
    printStatus = str(filePath) + "\n" + "  " + "Successfully processed the text file"
# ---------- end python ----------
panel = Panel(python.printStatus)
