# Grasshopper definition addGUIDsasgeoinGH.gh (Grasshopper 1.0.7)

# This Component Extracts the Curve from the GUID .
# 
# Example of GUID in Rhino:
# 652c0748-e239-436b-a197-4fda9c164292 (939)
# Please delete the (939) ie last three numbers & brackets from the GUID
panel = Panel("a362429c-5232-4107-b2f0-6863d8dffbde")
python = GhPythonScript(crvA_GUID=panel, crvB_GUID="652c0748-e239-436b-a197-4fda9c164292")  # -> out, crvA, crvB, crvDict; inputs crvA_GUID: Guid, crvB_GUID: Guid
# ---------- python: Python ----------
"""
This Component adds Rhino Geometry from their GUIDs into Grasshopper3D without selecting the Curves
This strategy can be applied similarly to other Geometry Types
"""

__author__ = "Abhishek Shinde"
__contact__ = "arabhishek1091@gmail.com"
__version__ = "2020.03.09"


import Rhino
import scriptcontext as sc
import rhinoscriptsyntax as rs

#Always use Step1,2 & 3 for rhinosscriptsyntax to extarct curve from Rhino GUID
#Step1 - set focus on Rhino document
sc.doc = Rhino.RhinoDoc.ActiveDoc

#Step 2 - Do something in the Active Rhino Document
crvB = rs.coercecurve(crvB_GUID)
crvA = rs.coercecurve(crvA_GUID)

#Step3- set focus back on GH document
sc.doc = ghdoc

#Using GUID's as keys for the dictonaries
crvDict = { crvA_GUID: crvA  , crvB_GUID :crvB}

print(type(crvA))
print(type(crvA_GUID))
print(type(crvB))
print(type(crvB_GUID))
print(type(crvDict))
print(crvDict[crvA_GUID])
# ---------- end python ----------
crv = Curve(python.crvA)
panel_2 = Panel(python.crvDict)
crv_2 = Curve(python.crvB)
